# Grasshopper definition Color palette.gh (Grasshopper 1.0.7)
# Copyright: Co-de-iT

c_script = CSharpScript()  # -> out, C, cn
# ---------- c_script: C# usings ----------
using System.Drawing;
using Grasshopper.GUI.Gradient;
# ---------- c_script: C# ----------
    myPalette = new Color[colors.Length];
    for (int i = 0; i < colors.Length; i++)
      myPalette[i] = ColorTranslator.FromHtml(colors[i]);

    C = myPalette;
    cn = colors;
# ---------- c_script: C# additional code ----------
  public string[] colors = new string[]{
   "#c0392b","#7f8c8d","#da4453", "#bdc3c7","#e74c3c",   "#ed1515", "#f47750", "#d35400", "#fdbc4b", "#f67400", "#c9ce3b", "#f39c1f",
    "#1cdc9a", "#11d116", "#2ecc71", "#27ae60", "#1abc9c", "#16a085", "#3498db", "#2980be", "#3daee9", "#1d9913", "#9b59b6", "#8e44ad",
    "#34495e", "#2c3e50", "#31363b", "#232629",  "#4d4d4d",  "#95a5a6", "#fcfcfc", "#eff0f1"
    };
  public string[] colorsPalette = new string[]{
    "#e74c3c", "#da4453", "#ed1515", "#c0392b", "#f47750", "#d35400", "#fdbc4b", "#f67400", "#c9ce3b", "#f39c1f",
    "#1cdc9a", "#11d116", "#2ecc71", "#27ae60", "#1abc9c", "#16a085", "#3498db", "#2980be", "#3daee9", "#1d9913", "#9b59b6", "#8e44ad",
    "#34495e", "#2c3e50", "#31363b", "#232629", "#7f8c8d", "#4d4d4d", "#bdc3c7", "#95a5a6", "#fcfcfc", "#eff0f1"
    };
  public Color[] myPalette;
  public Color[] objPalette = new Color[] {
    ColorTranslator.FromHtml("#e74c3c"),
    ColorTranslator.FromHtml("#da4453"),
    ColorTranslator.FromHtml("#ed1515"),
    ColorTranslator.FromHtml("#c0392b"),

    ColorTranslator.FromHtml("#2c3e50"),
    Color.LightSteelBlue,
    Color.YellowGreen,
    Color.PaleGoldenrod,
    Color.DodgerBlue,

    Color.DarkKhaki,
    Color.DimGray,
    Color.CadetBlue,
    Color.MidnightBlue,
    Color.Plum,
    Color.Goldenrod,
    Color.Olive,
    Color.Snow,
    Color.DarkRed,
    Color.Gold,
    Color.PaleTurquoise,
    Color.Violet,

    Color.DarkSlateGray,
    Color.DarkGoldenrod,
    Color.DeepPink,
    Color.DarkOliveGreen};

  //public Color col = GH_Gradient.Spectrum().ColourAt(0.5);
# ---------- end c_script ----------
lng = ListLength(List=c_script.C)
rectangle = Rectangle(Plane=PlaneXY(0, 0, 0), XSize="2", YSize="0.8", Radius=0)  # -> Rectangle, Length
mplane = MeshPlane(Boundary=rectangle.Rectangle, WidthCount="1", HeightCount="1")  # -> Mesh, Area
# <title>
# 
# <description>
# 
# code by Alessio Erioli
# 
# v 0.1
# © a3 2021 / Creative Commons Attribution-Non Commercial-ShareAlike 4.0 International License
legend = Legend(Colour=c_script.C, Tags=c_script.cn, LegendType=1)
mesh = Mesh([<mesh referenced from the Rhino model> x32])
mesh_2 = Mesh([<mesh referenced from the Rhino model> x3])
facen = FaceNormals(Mesh=mesh)  # -> flatten(Centers), Normals
lng_2 = ListLength(List=mesh_2)  # -> expr("x-1", Length)
Y = UnitY(Factor=1)
pdecon = Deconstruct(Point=facen.Centers)  # -> XComponent, YComponent, ZComponent
larger = LargerThan(FirstNumber=pdecon.YComponent, SecondNumber="0")  # -> LargerThan, OrEqualTo
mplane_2 = MeshPlane(Boundary=rectangle.Rectangle, WidthCount="1", HeightCount="1")  # -> Mesh, Area
cull = CullPattern(List=mesh, CullPattern=larger.LargerThan)
cull_2 = CullPattern(List=pdecon.YComponent, CullPattern=larger.LargerThan)
arrlinear = LinearArray(Geometry=mplane_2.Mesh, Direction=Y, Count=lng)  # -> Geometry, Transform
sort = SortList(Keys=cull_2, ValuesA=cull)  # -> Keys, reverse(ValuesA)
mcol = MeshColours(Mesh=graft(arrlinear.Geometry), Colours=graft(c_script.C))
demesh = DeconstructMesh(Mesh=sort.ValuesA)  # -> Vertices, Faces, Colours, Normals
item = ListItem(List=demesh.Colours, Index=0, Wrap=True)  # -> flatten(Item)
subset = SubList(List=item, Domain=lng_2, Wrap=True)  # -> List, Index
mcol_2 = MeshColours(Mesh=graft(mesh_2), Colours=graft(subset.List))
panel = Panel(item)
c_script_2 = CSharpScript(C=panel)  # -> out, S; inputs C: list of String
# ---------- c_script_2: C# ----------
    String palette = "private readonly Color[] palette = new Color[] {";

    for(int i = 0; i < C.Count - 1; i++)
    {
      if (i % 4 == 0) palette += Environment.NewLine;
      palette += "Color.FromArgb(" + C[i] + "), ";

    }
    palette += "Color.FromArgb(" + C[C.Count - 1] + ")};";

    S = palette;
# ---------- end c_script_2 ----------
panel_2 = Panel(c_script_2.S)
legend_2 = Legend(Colour=item, Tags=panel, LegendType=1)
